# Grasshopper definition TopoOpt.gh (Grasshopper 1.0.8)

# Drop Brep File (.3dm)
brep = Brep(<brep referenced from the Rhino model>)

mesh = MeshBrep(
    Brep=brep,
    Settings={GridMaxCount=0, GridMinCount=16, JaggedSeams=False, MaxEdgeLength=0, MinEdgeLength=0.0001, MinTolerance=0, Refine=True, RefineAngle=0, RelativeTolerance=0.65, SimplePlanes=True, Tolerance=0})
demesh = DeconstructMesh(Mesh=mesh)  # -> Vertices, Faces, Colours, Normals
debrep = DeconstructBrep(Brep=brep)  # -> Faces, Edges, Vertices
sort = SortList(Keys=debrep.Vertices, ValuesA=debrep.Vertices)  # -> Keys, ValuesA
sort_pt = SortPoints(Points=sort.ValuesA)  # -> Points, Indices
pdecon = Deconstruct(Point=sort_pt.Points)  # -> XComponent, YComponent, ZComponent
max = Maximum(A="1", B=pdecon.ZComponent)
equals = Equality(FirstNumber=pdecon.ZComponent, SecondNumber=max)  # -> Equality, Inequality
cull = CullPattern(List=sort_pt.Points, CullPattern=equals.Inequality)
cull_2 = CullPattern(List=sort_pt.Points, CullPattern=equals.Equality)

volume = Volume(Geometry=brep)  # -> Volume, Centroid
Z = UnitZ(Factor="9.81")
xy = XYPlane(Origin=Point(0, 0, 0))
division = Division(A=volume.Volume, B=Slider(1.5, range=0..1.5))
neg = Negative(Value=Z)
rigidbody = RigidBody(Part=mesh, Plane=xy, Points=demesh.Vertices, Strength=Slider(9000, range=0..9000))  # -> RigidBody, Planes
anchor = Anchor(Point=cull, Target=cull, Strength=Slider(15000, range=0..15000))
load = Load(Point=cull_2, ForceVector=neg, Weighting=Slider(700, range=0..700))
volume_2 = Volume(Mesh=mesh, Volume=division, Strength=Slider(6500, range=0..6500))
bouncysolver = BouncySolver(
    GoalObjects=[anchor, load, volume_2, rigidbody.RigidBody],
    Reset=Toggle(False),
    Threshold="0.0001",
    Tolerance="0.0001",
    Damping=0.99,
    Iterations=1000,
    On=True)  # -> I, V, O

# ----
# Edit
number_slider = Slider(3, range=1..5)

cube = Integer(Slider(0, range=0..1))
segment = Integer(Slider(3.6, range=0..10))
smooth = Integer(Slider(5, range=0..5))
pipe_width = Integer(Slider(1, range=0..10))
round = Integer(Slider(11, range=1..30))
tolerance = Integer(Slider(3, range=1..30))
spacing = Integer(Slider(0, range=0..150))
links = Integer(number_slider)

prox = Proximity3D(Points=bouncysolver.V, Group=links, MinRadius=spacing)  # -> flatten(Links), Topology
mp = MultiPipe(
    Curves=prox.Links,
    NodeSize=tolerance,
    SizePoints=bouncysolver.V,
    EndOffset=round,
    StrutSize=pipe_width,
    Segment=segment,
    KinkAngle=0.6,
    CubeFit=cube,
    Caps="1")
meshsubd = MeshFromSubD(SubD=mp, Density=smooth)
